# Dynamo graph FreeformCreate.dyn (Dynamo 2.12.1.8246)

python_script = Python()  # IronPython2; frozen; unwired: IN[0], IN[1]
# ---------- python_script.python (91 lines) ----------
import clr

clr.AddReference('RevitAPI')
from Autodesk.Revit.DB import *
from Autodesk.Revit.DB.Structure import *

clr.AddReference('RevitAPIUI')
from Autodesk.Revit.UI import *

clr.AddReference('System')
from System.Collections.Generic import List, IList

clr.AddReference('RevitNodes')
import Revit
clr.ImportExtensions(Revit.GeometryConversion)
clr.ImportExtensions(Revit.Elements)

clr.AddReference('RevitServices')
import RevitServices
from RevitServices.Persistence import DocumentManager
from RevitServices.Transactions import TransactionManager

doc = DocumentManager.Instance.CurrentDBDocument
uidoc = DocumentManager.Instance.CurrentUIApplication.ActiveUIDocument

cuboid = UnwrapElement(IN[0])

elem_num = 766598
elem_id = ElementId(elem_num)
elem = doc.GetElement(elem_id)

geoOptions = Options()
if elem is not None:
	geom = elem.get_Geometry(geoOptions)


lstPtA = [XYZ(0,0,0), XYZ(25,0,0), XYZ(25,25,0), XYZ(0,25,0)]
lstPtA.append(lstPtA[0])
lstCurveA = [Line.CreateBound(lstPtA[idx -1], pt) for idx, pt in enumerate(lstPtA) if idx > 0]
curvloopA = CurveLoop.Create(lstCurveA)
curveLoopList = List[CurveLoop]([curvloopA])



materialIdSteel = ElementId(509467)

solidOpt = SolidOptions(materialIdSteel, ElementId.InvalidElementId)


with Transaction(doc, "Test") as tr:
	tr.Start()
	solid = GeometryCreationUtilities.CreateExtrusionGeometry(curveLoopList, XYZ(0,0,1),30,solidOpt)
	geomList = List[GeometryObject]()
	geomList.Add(solid)
	
	ds = DirectShape.CreateElement(doc, ElementId(BuiltInCategory.OST_GenericModel));
	ds.ApplicationId = "Application id";
	ds.ApplicationDataId = "Geometry object id";
	
	ds.SetShape(geomList);
	OUT = ds.Id
	tr.Commit()



#solid = None
#for geo in geom:
#	if isinstance(geo, Solid):
#		solid = geo
		
#solid = geom as Solid()
#geomList = List[GeometryObject]()
#geomList.Add(solid)




#with Transaction(doc, "Test") as tr:
#	tr.Start()
#	#if solid is not None:
#	#	freeform = FreeFormElement.Create(doc, solid)
#
#	ds = DirectShape.CreateElement(doc, ElementId(BuiltInCategory.OST_GenericModel));
#	
#	ds.ApplicationId = "Application id";
#	ds.ApplicationDataId = "Geometry object id";
#	ds.SetShape(geomList);
#
#	tr.Commit()
#	
#OUT = ds
# ----------------------------------------
watch = Watch(python_script)
python_script_2 = Python()  # IronPython2; unwired: IN[0], IN[1]
# ---------- python_script_2.python (37 lines) ----------
import clr

clr.AddReference('RevitAPI')
from Autodesk.Revit.DB import *
from Autodesk.Revit.DB.Structure import *

clr.AddReference('RevitAPIUI')
from Autodesk.Revit.UI import *

clr.AddReference('System')
from System.Collections.Generic import List

clr.AddReference('RevitNodes')
import Revit
clr.ImportExtensions(Revit.GeometryConversion)
clr.ImportExtensions(Revit.Elements)

clr.AddReference('RevitServices')
import RevitServices
from RevitServices.Persistence import DocumentManager
from RevitServices.Transactions import TransactionManager

doc = DocumentManager.Instance.CurrentDBDocument
uidoc = DocumentManager.Instance.CurrentUIApplication.ActiveUIDocument

OUT = []

selection = uidoc.Selection
ids = selection.GetElementIds()

if ids.Count > 0:
	for id in ids:
		elem = doc.GetElement(id)
		materials = elem.GetMaterialIds(False)
		for matId in materials:
			matName = doc.GetElement(matId).Name
			OUT.append([matId, matName])
# ----------------------------------------
watch_2 = Watch(python_script_2)
