# Dynamo graph GetMaterialPy.dyn (Dynamo 2.12.1.8246)

python_script = Python()  # IronPython2; unwired: IN[0], IN[1]
# ---------- python_script.python (37 lines) ----------
import clr

clr.AddReference('RevitAPI')
from Autodesk.Revit.DB import *
from Autodesk.Revit.DB.Structure import *

clr.AddReference('RevitAPIUI')
from Autodesk.Revit.UI import *

clr.AddReference('System')
from System.Collections.Generic import List

clr.AddReference('RevitNodes')
import Revit
clr.ImportExtensions(Revit.GeometryConversion)
clr.ImportExtensions(Revit.Elements)

clr.AddReference('RevitServices')
import RevitServices
from RevitServices.Persistence import DocumentManager
from RevitServices.Transactions import TransactionManager

doc = DocumentManager.Instance.CurrentDBDocument
uidoc = DocumentManager.Instance.CurrentUIApplication.ActiveUIDocument

OUT = []

selection = uidoc.Selection
ids = selection.GetElementIds()

if ids.Count > 0:
	for id in ids:
		elem = doc.GetElement(id)
		materials = elem.GetMaterialIds(False)
		for matId in materials:
			matName = doc.GetElement(matId).Name
			OUT.append(matName)
# ----------------------------------------
watch = Watch(python_script)
