# Dynamo graph SetParam.dyn (Dynamo 2.12.1.8246)

python_script = Python()  # IronPython2; unwired: IN[0], IN[1]
# ---------- python_script.python (43 lines) ----------
import clr

clr.AddReference('RevitAPI')
from Autodesk.Revit.DB import *
from Autodesk.Revit.DB.Structure import *

clr.AddReference('RevitAPIUI')
from Autodesk.Revit.UI import *

clr.AddReference('System')
from System.Collections.Generic import List

clr.AddReference('RevitNodes')
import Revit
clr.ImportExtensions(Revit.GeometryConversion)
clr.ImportExtensions(Revit.Elements)

clr.AddReference('RevitServices')
import RevitServices
from RevitServices.Persistence import DocumentManager
from RevitServices.Transactions import TransactionManager

doc = DocumentManager.Instance.CurrentDBDocument
uidoc = DocumentManager.Instance.CurrentUIApplication.ActiveUIDocument

selIds = uidoc.Selection.GetElementIds()

OUT = []

if selIds.Count > 0:
	elem = doc.GetElement(selIds[0])
	#Do some action in a Transaction
	if isinstance(elem, FamilyInstance):
		with Transaction(doc, "Test") as tr:
			tr.Start()
			paramName = "SuperDuperParam"
			param = elem.LookupParameter(paramName)
			param.Set("SuperduperValueOfParam")
			
			tr.Commit()


OUT.append(selIds)
# ----------------------------------------
watch = Watch(python_script)
